# Grasshopper definition ExampleFile.gh (Grasshopper 1.0.7)
# plug-ins: Hops

gallery = ImageGallery(CycleDelay=30, Randomize=False, UseLocalImages=True, UseRemoteImages=True)
hops = Hops(
    Num1=Slider(1.2, range=0..10),
    Num2=Slider(5.2, range=0..10),
    Num3=1,
    CacheResultsInMemory=True,
    CacheSolveResults=True,
    RemoteDefinitionLocation="C:\Users\ykish\Documents\GitHub\HopsTest\HopesTest.gh",
    RemoteSolveVersion=(0, 1, 0),
    ShowInput_Enabled=False,
    ShowInput_Path=False,
    SynchronousSolve=True)
panel = Panel(hops)

# ----
# Color Format
# Input
data = Data(1)
# Method
data_2 = Data(1)
# Output
data_3 = Data(1)
# Display
data_4 = Data(1)
# Unuse
data_5 = Data(1)
