# Grasshopper definition HopesTest.gh (Grasshopper 1.0.7)

gallery = ImageGallery(CycleDelay=30, Randomize=False, UseLocalImages=True, UseRemoteImages=True)
get_geometry = GetGeometry(AtLeast=1, AtMost=1, DeleteInput=False, Filter=1074004029, TreeAccess=False)
get_boolean = GetBoolean(AtLeast=1, AtMost=1, FalseValue="False", TreeAccess=False, TrueValue="True")
get_file_path = GetFilePath(AtLeast=1, AtMost=1, TreeAccess=False)
get_string = GetString(AtLeast=1, AtMost=1, TreeAccess=False)
get_number = GetNumber(AtLeast=1, AtMost=1, Maximum=1.797693135e+308, Minimum=-1.797693135e+308, TreeAccess=False)
num1 = GetInteger(Slider(1, range=0..1), AtLeast=1, AtMost=1, Maximum=2147483647, Minimum=-2147483648, TreeAccess=False)

# ----
# Color Format
# Input
data = Data(1)
# Method
data_2 = Data(1)
# Output
data_3 = Data(1)
# Display
data_4 = Data(1)
# Unuse
data_5 = Data(1)

data_6 = Data(get_file_path)
filepath = ContextPrint(Integer=num1)
filepath_2 = ContextPrint(Geometry=get_geometry)
filepath_3 = ContextPrint(Result=data_6)
filepath_4 = ContextPrint(String=get_string)
